# Dynamo graph 01_Calcular y crear laminas.dyn (Dynamo 4.0.2.3852)
# Calcula cuantas laminas hacen falta para las vistas de assembly pendientes (simulando el mismo empaquetado que 02_Colocar vistas en laminas) y crea esa cantidad exacta, con la vineta y numeracion elegidas.

viñeta_title_block_elegir_del = FamilyTypes("BIOS_E_VINE_A1_NOVANDINO:Formato-DETALLE")  # "Viñeta (Title Block) — elegir del dropdown"; graph input
numero_del_primer_sheet = StringInput("TEST")  # graph input
nombre_del_primer_sheet = StringInput("ARMADURAS - HOJA 01")  # graph input
procesar_todos_los_assemblies = BoolSelector(true)  # graph input
filtro_assemblies_si_todos_false = StringInput("")  # graph input
margen_y_separacion_mm = IntegerSlider(5, range=5..50 step 1)  # graph input
reserva_lado_derecho_mm = IntegerSlider(150, range=0..200 step 5)  # graph input
py_calcular_y_crear_laminas = Python(IN[0]=viñeta_title_block_elegir_del, IN[1]=numero_del_primer_sheet, IN[2]=nombre_del_primer_sheet, IN[3]=procesar_todos_los_assemblies, IN[4]=filtro_assemblies_si_todos_false, IN[5]=margen_y_separacion_mm, IN[6]=reserva_lado_derecho_mm)  # PythonNet3
# ---------- py_calcular_y_crear_laminas.python (278 lines) ----------
# 03_Calcular y crear laminas - calcula cuantas laminas hacen falta para las
# vistas de assembly pendientes (simulando el mismo empaquetado que
# 02_Colocar vistas en laminas, con una lamina de prueba para medir el area
# util real de la vineta) y crea esa cantidad exacta, con la numeracion de
# siempre (mismo mecanismo de numeracion incremental).
# Revit 2027 / Dynamo 4 / CPython3
# IN[0] = tipo de vineta (dropdown Family Types)
# IN[1] = numero del primer sheet
# IN[2] = nombre del primer sheet
# IN[3] = procesar todos los assemblies (bool)
# IN[4] = filtro de assemblies si IN[3] es False (parcial, comas)
# IN[5] = margen y separacion entre vistas (mm) - debe coincidir con el mismo
#         input de 02_Colocar vistas en laminas para que el calculo sea exacto
# IN[6] = reserva en el lado derecho (mm) - idem, debe coincidir con 04
#         (incluye el espacio reservado para la futura tabla de cantidades)

import clr
import re
clr.AddReference('RevitAPI')
clr.AddReference('RevitServices')
from Autodesk.Revit.DB import (FilteredElementCollector, AssemblyInstance, ViewSheet,
                               Viewport, View, BuiltInCategory, Element, ElementId)
from RevitServices.Persistence import DocumentManager
from RevitServices.Transactions import TransactionManager

doc = DocumentManager.Instance.CurrentDBDocument

tb_type = UnwrapElement(IN[0])
first_number = (IN[1] or '').strip()
first_name = (IN[2] or '').strip()
process_all = bool(IN[3])
filter_text = (IN[4] or '').strip()
margin = float(IN[5]) / 304.8
right_reserve = float(IN[6]) / 304.8
# debe coincidir con gap_bloque de 02_Colocar vistas en laminas: la separacion
# REAL dentro de cada bloque (planta -> corte A -> corte B) es el margen general
# mas 10 mm fijos, no el margen general solo (ver nota en ese graph). Si la
# simulacion de aca no usa el mismo valor, subestima el alto de cada bloque y
# calcula menos laminas de las que 02 realmente necesita.
gap_bloque = margin + 10.0 / 304.8

log = []
# contrato de nombres de la rutina de ARMADURAS (ver 00): planta 'FN-1001 -
# ARMADURA', cortes 'FN-1001 - ARMADURA - CORTE A/B'. Las vistas de Formas
# (FN-1001 a secas) no participan de esta rutina.
SUFIJO_ARMADURAS = ' - ARMADURA'
SUFIJO_CORTE = SUFIJO_ARMADURAS + ' - CORTE A'
SUFIJO_CORTE_B = SUFIJO_ARMADURAS + ' - CORTE B'
SUFIJOS_CORTE = (SUFIJO_CORTE, SUFIJO_CORTE_B)
# callouts de pedestal (00): 'FN-1001 - ARMADURA - PEDESTAL PD-1003'. Cantidad variable
# por assembly (0, 1 o mas segun cuantos TIPOS de C-Pedestal tenga) - se agregan al
# bloque despues de los cortes, mismo eje vertical (2026-07-21, pedido de Javier: antes
# 00 los creaba pero nunca se contaban ni colocaban en laminas).
PREFIJO_PEDESTAL = SUFIJO_ARMADURAS + ' - PEDESTAL '

label_h_planta = 12.0 / 304.8
label_h_corte = (12.0 + 14.0) / 304.8

def sufijo_corte(nombre):
    for a in SUFIJOS_CORTE:
        if nombre.endswith(a):
            return a
    return None

def es_callout_pedestal(nombre):
    return PREFIJO_PEDESTAL in nombre

def elem_name(e):
    try:
        return e.Name
    except Exception:
        return Element.Name.__get__(e)

def tb_label(t):
    try:
        return '{} : {}'.format(t.FamilyName, elem_name(t))
    except Exception:
        return 'Id ' + str(t.Id)

def list_titleblocks():
    col = (FilteredElementCollector(doc)
           .OfCategory(BuiltInCategory.OST_TitleBlocks)
           .WhereElementIsElementType())
    return list(col)

def label_h_de(v):
    nombre = elem_name(v)
    return label_h_corte if (sufijo_corte(nombre) or es_callout_pedestal(nombre)) else label_h_planta

def paper_size(v):
    # tamaño en papel (pies) = crop del modelo / escala
    cb = v.CropBox
    s = v.Scale if v.Scale > 0 else 1
    return ((cb.Max.X - cb.Min.X) / s, (cb.Max.Y - cb.Min.Y) / s)

def medidas(grupo):
    # bloque vertical: planta arriba, corte(s) abajo - igual que 04
    ws = []
    hs = []
    for v in grupo:
        w, h = paper_size(v)
        ws.append(w)
        hs.append(h + label_h_de(v))
    bw = max(ws)
    bh = sum(hs) + gap_bloque * (len(grupo) - 1)
    return bw, bh

def usable_rect(sheet):
    # area util = bbox de la viñeta menos margenes (y reserva derecha, incluida
    # la futura tabla de cantidades)
    col = FilteredElementCollector(doc, sheet.Id).OfCategory(BuiltInCategory.OST_TitleBlocks)
    tb = col.FirstElement()
    if tb is not None:
        bb = tb.get_BoundingBox(sheet)
        if bb is not None:
            return (bb.Min.X + margin, bb.Min.Y + margin,
                    bb.Max.X - margin - right_reserve, bb.Max.Y - margin)
    o = sheet.Outline
    return (o.Min.U + margin, o.Min.V + margin,
            o.Max.U - margin - right_reserve, o.Max.V - margin)

def bump(text, steps):
    # incrementa el ULTIMO bloque numerico conservando el ancho (ceros a la izquierda)
    last = None
    for m in re.finditer('\\d+', text):
        last = m
    if last is None:
        return '{} {:02d}'.format(text, steps + 1)
    width = len(last.group(0))
    val = int(last.group(0)) + steps
    return text[:last.start()] + str(val).zfill(width) + text[last.end():]

# --- validar la vineta seleccionada ---
tb_cat_id = ElementId(BuiltInCategory.OST_TitleBlocks)
is_tb = (tb_type is not None
         and tb_type.Category is not None
         and tb_type.Category.Id == tb_cat_id)

if not is_tb:
    log.append('ERROR: el tipo seleccionado en el dropdown NO es una viñeta (Title Block).')
    log.append('Selecciona una de estas viñetas cargadas en el proyecto:')
    tbs = list_titleblocks()
    if not tbs:
        log.append('  (no hay viñetas cargadas en el proyecto)')
    for t in tbs:
        log.append('  - ' + tb_label(t))
    OUT = log
else:
    # --- bloques pendientes: planta + corte A + corte B por assembly, salvo lo ya colocado ---
    by_type = {}
    for ai in FilteredElementCollector(doc).OfClass(AssemblyInstance):
        by_type.setdefault(ai.AssemblyTypeName, []).append(ai)

    names = sorted(by_type.keys())
    if not process_all:
        tokens = [t.strip().lower() for t in filter_text.split(',') if t.strip()]
        if tokens:
            names = [n for n in names if any(tok in n.lower() for tok in tokens)]
        else:
            names = []
            log.append('ERROR: \"Todos\" esta en False y el filtro esta vacio.')

    view_by_name = {}
    for v in FilteredElementCollector(doc).OfClass(View):
        if not v.IsTemplate:
            view_by_name[elem_name(v)] = v

    placed_ids = set()
    for vp in FilteredElementCollector(doc).OfClass(Viewport):
        placed_ids.add(vp.ViewId.Value)

    bloques = []
    for n in names:
        grupo = []
        for vname in (n + SUFIJO_ARMADURAS, n + SUFIJO_CORTE, n + SUFIJO_CORTE_B):
            v = view_by_name.get(vname)
            if v is None:
                log.append('AVISO: no existe la vista \"{}\" (corre 00_Vistas de assembly).'.format(vname))
            elif v.Id.Value in placed_ids:
                pass  # ya colocada en una lamina, no cuenta como pendiente
            else:
                grupo.append(v)
        prefijo_ped = n + PREFIJO_PEDESTAL
        for vname_ped in sorted(nm for nm in view_by_name if nm.startswith(prefijo_ped)):
            v_ped = view_by_name[vname_ped]
            if v_ped.Id.Value not in placed_ids:
                grupo.append(v_ped)
        if grupo:
            bloques.append(grupo)

    if not bloques:
        log.append('No hay vistas pendientes de colocar; no se creo ninguna lamina.')
        OUT = log
    else:
        created = 0
        sheets_needed = 0
        TransactionManager.Instance.EnsureInTransaction(doc)
        try:
            if hasattr(tb_type, 'IsActive') and not tb_type.IsActive:
                tb_type.Activate()

            # --- medir el area util real de esta vineta con una lamina de prueba ---
            probe = ViewSheet.Create(doc, tb_type.Id)
            doc.Regenerate()
            x0, y0, x1, y1 = usable_rect(probe)
            doc.Delete(probe.Id)

            # --- simulacion en seco: mismo empaquetado que 02_Colocar vistas en laminas,
            #     pero abriendo laminas virtuales bajo demanda en vez de una lista fija ---
            state = None
            for grupo in bloques:
                bw, bh = medidas(grupo)
                done = False
                while not done:
                    if state is None:
                        sheets_needed += 1
                        state = {'cx': x0, 'cy': y1, 'row_h': 0.0}
                    if state['cx'] > x0 and state['cx'] + bw > x1:
                        state['cx'] = x0
                        state['cy'] -= state['row_h'] + margin
                        state['row_h'] = 0.0
                    if state['cy'] - bh < y0 or state['cx'] + bw > x1:
                        fresh = (state['cx'] == x0 and state['cy'] == y1)
                        if not fresh:
                            state = None
                            continue
                        log.append('AVISO: \"{}\" ({:.0f} x {:.0f} mm en papel) excede el area util de una lamina completa; ocupara una lamina para si sola.'.format(
                            elem_name(grupo[0]), bw * 304.8, bh * 304.8))
                    state['cx'] += bw + margin
                    if bh > state['row_h']:
                        state['row_h'] = bh
                    done = True

            # --- crear esa cantidad de laminas, con la numeracion de siempre ---
            if not first_number:
                first_number = 'A-001'
                log.append('AVISO: numero inicial vacio, se usa A-001.')
            if not first_name:
                first_name = 'SIN NOMBRE 01'
                log.append('AVISO: nombre inicial vacio, se usa SIN NOMBRE 01.')

            existing = set()
            for vs in FilteredElementCollector(doc).OfClass(ViewSheet):
                existing.add(vs.SheetNumber)

            plan = []
            produced = 0
            offset = 0
            while produced < sheets_needed and offset < sheets_needed + 1000:
                num = first_number if offset == 0 else bump(first_number, offset)
                offset += 1
                if num in existing:
                    log.append('AVISO: el numero {} ya existe en el proyecto, se salta.'.format(num))
                    continue
                name = first_name if produced == 0 else bump(first_name, produced)
                plan.append((num, name))
                existing.add(num)
                produced += 1

            for num, name in plan:
                try:
                    sheet = ViewSheet.Create(doc, tb_type.Id)
                    sheet.SheetNumber = num
                    try:
                        sheet.Name = name
                    except Exception:
                        Element.Name.__set__(sheet, name)
                    created += 1
                    log.append('OK: {}  |  {}'.format(num, name))
                except Exception as e:
                    log.append('ERROR creando {}: {}'.format(num, e))
        finally:
            TransactionManager.Instance.TransactionTaskDone()

        log.insert(0, 'Vineta usada: ' + tb_label(tb_type))
        log.insert(1, 'Laminas necesarias calculadas: {} | creadas: {}'.format(sheets_needed, created))
        log.append('Listo. Ahora corre 02_Colocar vistas en laminas para distribuir las vistas en estas laminas.')
        OUT = log
# ----------------------------------------
log = Watch(py_calcular_y_crear_laminas)  # graph output
