# Dynamo graph 02_Colocar vistas en laminas.dyn (Dynamo 4.0.2.3852)
# PASO 3 de 5 - Coloca las vistas en las laminas: por cada assembly, planta arriba y cortes abajo, en grilla y con su titulo. Pasa a la lamina siguiente cuando una se llena. Requiere los pasos 1 y 2.

sheets_destino_numeros_con_coma = StringInput("test")  # "Sheets destino (numeros con coma, o prefijo)"; graph input
procesar_todos_los_assemblies = BoolSelector(true)  # graph input
filtro_assemblies_si_todos_false = StringInput("")  # graph input
margen_y_separacion_mm = IntegerSlider(5, range=5..50 step 1)  # graph input
reserva_lado_derecho_mm = IntegerSlider(200, range=0..200 step 5)  # graph input
tipo_de_viewport_para_plantas = StringInput("C_Titulo_General")  # graph input
tipo_de_viewport_para_cortes = StringInput("C_Titulo_Seccion")  # graph input
separacion_titulo_cortes_mm = IntegerSlider(19, range=5..40 step 1)  # graph input
separacion_de_vistas = IntegerSlider(100, range=40..200 step 5)  # graph input
py_colocar_viewports_en_grilla = Python(IN[0]=sheets_destino_numeros_con_coma, IN[1]=procesar_todos_los_assemblies, IN[2]=filtro_assemblies_si_todos_false, IN[3]=margen_y_separacion_mm, IN[4]=reserva_lado_derecho_mm, IN[5]=tipo_de_viewport_para_plantas, IN[6]=tipo_de_viewport_para_cortes, IN[7]=separacion_titulo_cortes_mm, IN[8]=separacion_de_vistas)  # PythonNet3
# ---------- py_colocar_viewports_en_grilla.python (508 lines) ----------
# 02_Colocar vistas en laminas - Por assembly: planta arriba + cortes + callouts
# (mismo eje vertical), bloques repartidos en los sheets destino.
#
# EMPAQUETADO (reescrito 2026-07-23): se empaqueta y se apila por el tamano del
# CROP de cada vista (View.CropBox / escala, que el 00 deja ajustado al borde de
# la fundacion) MAS el titulo - NO por el contorno con lineas de seccion (esas
# cruces salen del crop, se extienden muchisimo mas que la fundacion y como son
# finas cruzarse con las vistas vecinas es normal; medir por ellas daba un bloque
# por pagina). Reparto SKYLINE (bottom-left): cada bloque cae en el hueco mas alto
# y a la izquierda, asi un bloque alto y angosto ocupa solo su columna y el resto
# del ancho se rellena con los siguientes. 01_Calcular usa la MISMA medida y el
# MISMO empaquetado. 02 mete la TOTALIDAD de las vistas en las laminas que ya
# existen (creadas por 01): NO crea laminas nuevas y NUNCA descarta una vista. Si el
# empaquetado necesita mas 'paginas' que laminas disponibles, esas paginas de mas se
# reparten (round-robin) sobre las mismas laminas y las vistas se MONTAN - el slider
# "Separacion de vistas (%)" es justamente para regular cuanto se montan: bajarlo
# hace que todo entre montado en pocas laminas, subirlo las separa en mas laminas.
#
# Leyendas: eliminado (2026-07-10 a 2026-07-21, pedido de Javier).
#
# Revit 2027 / Dynamo 4 / CPython3
# IN[0] = sheets destino: numeros separados por coma, o un prefijo comun
# IN[1] = procesar todos los assemblies (bool)
# IN[2] = filtro de assemblies si IN[1] es False (parcial, comas)
# IN[3] = margen y separacion entre vistas (mm)
# IN[4] = reserva en el lado derecho del sheet (mm)
# IN[5] = tipo de viewport para las PLANTAS (vacio = tipo por defecto)
# IN[6] = tipo de viewport para los CORTES (vacio = tipo por defecto)
# IN[7] = separacion del titulo bajo el borde de los cortes (mm)
# IN[8] = separacion de vistas (%) - regula cuantas vistas por lamina. 100 = ajustado
#         (denso); < 100 = mas montadas y menos laminas; > 100 = mas separadas y mas
#         laminas. DEBE coincidir con el mismo input de 01 para que cuadren.

import clr
clr.AddReference('RevitAPI')
clr.AddReference('RevitServices')
from Autodesk.Revit.DB import (FilteredElementCollector, AssemblyInstance, ViewSheet,
                               Viewport, View, ViewType, BuiltInCategory, XYZ, Element,
                               ElementType, ElementId, BuiltInParameter, FamilySymbol,
                               FamilyInstance, ViewDuplicateOption, StorageType)
from RevitServices.Persistence import DocumentManager
from RevitServices.Transactions import TransactionManager

doc = DocumentManager.Instance.CurrentDBDocument

sheets_text = (IN[0] or '').strip()
process_all = bool(IN[1])
filter_text = (IN[2] or '').strip()
margin = float(IN[3]) / 304.8
right_reserve = float(IN[4]) / 304.8
vp_type_text = (IN[5] or '').strip()
vp_type_text_sec = (IN[6] or '').strip()
gap_corte = float(IN[7]) / 304.8   # slider: distancia del titulo bajo el borde del corte
# separacion de vistas (%) - escala el hueco que reserva cada bloque al empaquetar
# (no el tamano real): < 100 monta las vistas, > 100 las separa. DEBE coincidir con
# 01. Si el input aun no existe (grafo sin re-abrir), cae a 100.
try:
    esc = float(IN[8]) / 100.0
except Exception:
    esc = 1.0
if esc < 0.2:
    esc = 0.2
gap_planta = 5.0 / 304.8
# reserva bajo cada vista para su titulo, usada para apilar y para el empaquetado
label_h_planta = 12.0 / 304.8
label_h_corte = (12.0 + 14.0) / 304.8
# separacion REAL dentro de cada bloque (planta -> corte A -> corte B -> callouts):
# margen general + 10 mm fijos.
gap_bloque = margin + 10.0 / 304.8

log = []
SUFIJO_ARMADURAS = ' - ARMADURA'
SUFIJO_CORTE = SUFIJO_ARMADURAS + ' - CORTE A'
SUFIJO_CORTE_B = SUFIJO_ARMADURAS + ' - CORTE B'
SUFIJOS_CORTE = (SUFIJO_CORTE, SUFIJO_CORTE_B)
PREFIJO_PEDESTAL = SUFIJO_ARMADURAS + ' - PEDESTAL '

def sufijo_corte(nombre):
    for a in SUFIJOS_CORTE:
        if nombre.endswith(a):
            return a
    return None

def es_callout_pedestal(nombre):
    return PREFIJO_PEDESTAL in nombre

def elem_name(e):
    try:
        return e.Name
    except Exception:
        return Element.Name.__get__(e)

def label_h_de(v):
    nombre = elem_name(v)
    return label_h_corte if (sufijo_corte(nombre) or es_callout_pedestal(nombre)) else label_h_planta

def paper_size(v):
    # tamano en papel (pies) = crop del modelo / escala (crop ya ajustado por 00)
    cb = v.CropBox
    s = v.Scale if v.Scale > 0 else 1
    return ((cb.Max.X - cb.Min.X) / s, (cb.Max.Y - cb.Min.Y) / s)

# --- tipos de viewport (plantas y cortes) ---
vp_types = [t for t in FilteredElementCollector(doc).OfClass(ElementType)
            if t.FamilyName == 'Viewport']

def crear_tipo_viewport(nombre):
    base = vp_types[0]
    nuevo = base.Duplicate(nombre)
    vp_types.append(nuevo)
    log.append('Tipo de viewport {} creado (duplicado de {}).'.format(nombre, elem_name(base)))
    p = nuevo.get_Parameter(BuiltInParameter.VIEWPORT_ATTR_SHOW_LABEL)
    if p is not None and not p.IsReadOnly and p.AsInteger() != 1:
        p.Set(1)
    pt = nuevo.get_Parameter(BuiltInParameter.VIEWPORT_ATTR_LABEL_TAG)
    if pt is not None and (pt.AsElementId() is None or pt.AsElementId().Value < 0):
        labels = list(FilteredElementCollector(doc).OfClass(FamilySymbol)
                      .OfCategory(BuiltInCategory.OST_ViewportLabel))
        if labels:
            pt.Set(labels[0].Id)
        else:
            log.append('AVISO: no hay ninguna familia View Title cargada en el proyecto; el tipo {} mostrara la linea pero no el texto.'.format(nombre))
            log.append('Carga una (Insertar > Cargar familia > Anotaciones > titulo de vista) y re-corre.')
    return nuevo

def buscar_tipo_viewport(texto, uso):
    if not texto:
        return None
    low = texto.lower()
    for t in vp_types:
        if elem_name(t).lower() == low:
            return t
    cands = [t for t in vp_types if low in elem_name(t).lower()]
    if len(cands) == 1:
        return cands[0]
    if len(cands) > 1:
        log.append('AVISO: hay {} tipos de viewport que coinciden parcialmente con \"{}\" (para {}); se usa el tipo por defecto.'.format(len(cands), texto, uso))
        log.append('Tipos disponibles: ' + ', '.join(sorted(elem_name(t) for t in vp_types)))
        return None
    return crear_tipo_viewport(texto)

vp_type = None
vp_type_sec = None

# --- sheets destino, ordenados por numero ---
all_sheets = {}
for s in FilteredElementCollector(doc).OfClass(ViewSheet):
    all_sheets[s.SheetNumber] = s

target_sheets = []
seen = set()
for tok in [t.strip() for t in sheets_text.split(',') if t.strip()]:
    if tok in all_sheets:
        matches = [all_sheets[tok]]
    else:
        matches = [s for n, s in all_sheets.items() if n.startswith(tok)]
    for s in matches:
        if s.SheetNumber not in seen:
            seen.add(s.SheetNumber)
            target_sheets.append(s)
target_sheets.sort(key=lambda s: s.SheetNumber)

if not target_sheets:
    log.append('ERROR: ningun sheet coincide con \"{}\".'.format(sheets_text))
    log.append('Sheets del proyecto: ' + ', '.join(sorted(all_sheets.keys())[:30]))
    OUT = log
else:
    by_type = {}
    for ai in FilteredElementCollector(doc).OfClass(AssemblyInstance):
        by_type.setdefault(ai.AssemblyTypeName, []).append(ai)
    names = sorted(by_type.keys())
    if not process_all:
        tokens = [t.strip().lower() for t in filter_text.split(',') if t.strip()]
        if tokens:
            names = [n for n in names if any(tok in n.lower() for tok in tokens)]
        else:
            names = []
            log.append('ERROR: \"Todos\" esta en False y el filtro esta vacio.')

    view_by_name = {}
    for v in FilteredElementCollector(doc).OfClass(View):
        if not v.IsTemplate:
            view_by_name[elem_name(v)] = v

    placed_ids = set()
    vp_by_view = {}
    for vp in FilteredElementCollector(doc).OfClass(Viewport):
        placed_ids.add(vp.ViewId.Value)
        vp_by_view[vp.ViewId.Value] = vp

    def titulo_corte(v, vp):
        try:
            num = vp.get_Parameter(BuiltInParameter.VIEWPORT_DETAIL_NUMBER).AsString()
            if not num:
                return
            base = elem_name(v)
            suf = sufijo_corte(base)
            if suf:
                base = base[:-len(suf)]
            p = v.get_Parameter(BuiltInParameter.VIEW_DESCRIPTION)
            if p is not None and not p.IsReadOnly:
                p.Set('{}{} - CORTE {}'.format(base, SUFIJO_ARMADURAS, num))
        except Exception:
            pass

    def letra(idx):
        s = ''
        n = idx + 1
        while n > 0:
            n, r = divmod(n - 1, 26)
            s = chr(65 + r) + s
        return s

    def asignar_letra(vp, sheet):
        usados = set()
        for vpid in sheet.GetAllViewports():
            ovp = doc.GetElement(vpid)
            try:
                dn = ovp.get_Parameter(BuiltInParameter.VIEWPORT_DETAIL_NUMBER).AsString()
                if dn:
                    usados.add(dn)
            except Exception:
                pass
        i = 0
        while letra(i) in usados:
            i += 1
        try:
            p = vp.get_Parameter(BuiltInParameter.VIEWPORT_DETAIL_NUMBER)
            if p is not None and not p.IsReadOnly:
                p.Set(letra(i))
        except Exception:
            pass

    # bloques por assembly: planta arriba + cortes + callouts, mismo eje vertical
    bloques = []
    retitular = []  # cortes ya colocados a los que actualizar el titulo en lamina
    for n in names:
        grupo = []
        for vname in (n + SUFIJO_ARMADURAS, n + SUFIJO_CORTE, n + SUFIJO_CORTE_B):
            v = view_by_name.get(vname)
            if v is None:
                log.append('AVISO: no existe la vista \"{}\" (corre 00_Vistas de assembly).'.format(vname))
            elif v.Id.Value in placed_ids:
                log.append('AVISO: \"{}\" ya esta en un sheet, se salta.'.format(vname))
                if sufijo_corte(vname) and v.Id.Value in vp_by_view:
                    retitular.append((v, vp_by_view[v.Id.Value]))
            else:
                grupo.append(v)
        prefijo_ped = n + PREFIJO_PEDESTAL
        for vname_ped in sorted(nm for nm in view_by_name if nm.startswith(prefijo_ped)):
            v_ped = view_by_name[vname_ped]
            if v_ped.Id.Value in placed_ids:
                pass
            else:
                grupo.append(v_ped)
        if grupo:
            bloques.append(grupo)

    def usable_rect(sheet):
        col = FilteredElementCollector(doc, sheet.Id).OfCategory(BuiltInCategory.OST_TitleBlocks)
        tb = col.FirstElement()
        if tb is not None:
            bb = tb.get_BoundingBox(sheet)
            if bb is not None:
                return (bb.Min.X + margin, bb.Min.Y + margin,
                        bb.Max.X - margin - right_reserve, bb.Max.Y - margin)
        o = sheet.Outline
        return (o.Min.U + margin, o.Min.V + margin,
                o.Max.U - margin - right_reserve, o.Max.V - margin)

    def tb_type_id_de(sheet):
        col = FilteredElementCollector(doc, sheet.Id).OfCategory(BuiltInCategory.OST_TitleBlocks)
        tb = col.FirstElement()
        return tb.GetTypeId() if tb is not None else ElementId.InvalidElementId

    def dims_bloque(grupo):
        ws = []
        hs = []
        for v in grupo:
            w, h = paper_size(v)
            ws.append(w)
            hs.append(h + label_h_de(v))
        bw = max(ws)
        bh = sum(hs) + gap_bloque * (len(grupo) - 1)
        return bw, bh

    # ---------------- empaquetado SKYLINE (identico a 01) ----------------
    EPS = 1e-9

    def depth_max(sky, a, b):
        d = 0.0
        for xi, xf, dep in sky:
            if xf <= a + EPS or xi >= b - EPS:
                continue
            if dep > d:
                d = dep
        return d

    def ocupa(sky, a, b, nd):
        nuevos = []
        for xi, xf, dep in sky:
            if xi < a - EPS:
                nuevos.append([xi, min(xf, a), dep])
            if xf > b + EPS:
                nuevos.append([max(xi, b), xf, dep])
        nuevos.append([a, b, nd])
        nuevos = [ss for ss in nuevos if ss[1] - ss[0] > EPS]
        nuevos.sort(key=lambda ss: ss[0])
        sky[:] = nuevos

    def mejor_pos(sky, x0, x1, H, ew, eh):
        best = None
        for seg in sky:
            x = seg[0]
            if x + ew > x1 + EPS:
                continue
            depth = depth_max(sky, x, x + ew)
            if depth + eh > H + EPS:
                continue
            if best is None or depth < best[1] - EPS or (abs(depth - best[1]) < EPS and x < best[0] - EPS):
                best = (x, depth)
        return best

    def bin_usado(sky):
        for xi, xf, dep in sky:
            if dep > EPS:
                return True
        return False

    def empaquetar(dims_bloques, x0, y0, x1, y1):
        H = y1 - y0
        bins = []
        asign = []
        avisos = []
        def nuevo():
            bins.append([[x0, x1, 0.0]])
            return len(bins) - 1
        cur = nuevo()
        for idx, (bw, bh) in enumerate(dims_bloques):
            # el hueco reservado por bloque se escala con la densidad (esc); el
            # tamano real de las vistas no cambia, asi que con esc < 1 se montan.
            ew = bw * esc
            eh = bh * esc
            pos = mejor_pos(bins[cur], x0, x1, H, ew, eh)
            # solo abrir lamina nueva si la actual YA tiene algo; si esta fresca y
            # aun asi no cabe, se coloca igual aca (evita la primera lamina vacia).
            if pos is None and bin_usado(bins[cur]):
                cur = nuevo()
                pos = mejor_pos(bins[cur], x0, x1, H, ew, eh)
            if pos is None:
                pos = (x0, 0.0)
                if bh > H:
                    avisos.append(idx)
            bx, depth = pos
            asign.append((cur, bx, y1 - depth))
            ocupa(bins[cur], bx, min(bx + ew, x1), depth + eh)
        return asign, len(bins), avisos

    def bump(text, steps):
        import re
        last = None
        for m in re.finditer('\\d+', text):
            last = m
        if last is None:
            return '{} {:02d}'.format(text, steps + 1)
        width = len(last.group(0))
        val = int(last.group(0)) + steps
        return text[:last.start()] + str(val).zfill(width) + text[last.end():]

    def colocar_grupo(grupo, x_izq, y_sup, bw, sheet):
        # apila las vistas del bloque por su tamano de CROP (compacto): cada vista
        # ocupa crop + titulo verticalmente, centrada en el mismo eje. Las lineas de
        # seccion que salen del crop cruzan las vistas vecinas (normal en estos
        # planos), no se cuentan para la separacion. El centrado horizontal se
        # ajusta con el contorno real solo en X (para alinear la columna).
        cx = x_izq + bw / 2.0
        y = y_sup
        n_ok = 0
        for v in grupo:
            cw, ch = paper_size(v)
            lh = label_h_de(v)
            centro = XYZ(cx, y - ch / 2.0, 0.0)
            try:
                vp = Viewport.Create(doc, sheet.Id, v.Id, centro)
                if vp is None:
                    log.append('ERROR: Revit no permitio colocar \"{}\" en {}.'.format(elem_name(v), sheet.SheetNumber))
                    y -= ch + lh + gap_bloque
                    continue
                es_corte = sufijo_corte(elem_name(v)) is not None
                es_seccional_v = es_corte or es_callout_pedestal(elem_name(v))
                t_apl = vp_type_sec if es_seccional_v else vp_type
                if t_apl is not None:
                    if vp.GetTypeId() != t_apl.Id:
                        vp.ChangeTypeId(t_apl.Id)
                    try:
                        gap = gap_corte if es_seccional_v else gap_planta
                        vp.LabelOffset = XYZ(0.0, -gap, 0.0)
                        vp.LabelLineLength = cw
                    except Exception:
                        pass
                if es_corte:
                    asignar_letra(vp, sheet)
                    titulo_corte(v, vp)
                # centrar la columna en X con el contorno real (no toca la Y, para
                # no inflar la separacion vertical con las lineas de seccion)
                try:
                    ob = vp.GetBoxOutline()
                    cxr = (ob.MaximumPoint.X + ob.MinimumPoint.X) / 2.0
                    c = vp.GetBoxCenter()
                    vp.SetBoxCenter(XYZ(c.X + (cx - cxr), c.Y, 0.0))
                except Exception:
                    pass
                n_ok += 1
                log.append('OK: \"{}\" -> sheet {}'.format(elem_name(v), sheet.SheetNumber))
                y -= ch + lh + gap_bloque
            except Exception as e:
                log.append('ERROR colocando \"{}\": {}'.format(elem_name(v), e))
                y -= ch + lh + gap_bloque
        return n_ok

    total_vistas = sum(len(g) for g in bloques)
    placed = 0
    overflow = []
    montados = 0

    TransactionManager.Instance.EnsureInTransaction(doc)
    try:
        vp_type = buscar_tipo_viewport(vp_type_text, 'plantas')
        vp_type_sec = buscar_tipo_viewport(vp_type_text_sec, 'cortes')

        # --- retrofit: cortes ya colocados -> letra + titulo ---
        def orden_visual(par):
            v_r, vp_r = par
            sh_r = doc.GetElement(vp_r.SheetId)
            c = vp_r.GetBoxCenter()
            return (sh_r.SheetNumber if sh_r is not None else '', -c.Y, c.X)
        retitular.sort(key=orden_visual)
        for v_fix, vp_fix in retitular:
            dn = None
            try:
                dn = vp_fix.get_Parameter(BuiltInParameter.VIEWPORT_DETAIL_NUMBER).AsString()
            except Exception:
                pass
            if not (dn and dn.isalpha()):
                sh_fix = doc.GetElement(vp_fix.SheetId)
                if sh_fix is not None:
                    asignar_letra(vp_fix, sh_fix)
            if vp_type_sec is not None and vp_fix.GetTypeId() != vp_type_sec.Id:
                try:
                    vp_fix.ChangeTypeId(vp_type_sec.Id)
                except Exception:
                    pass
            try:
                vp_fix.LabelOffset = XYZ(0.0, -gap_corte, 0.0)
                vp_fix.LabelLineLength = paper_size(v_fix)[0]
            except Exception:
                pass
            titulo_corte(v_fix, vp_fix)
        if retitular:
            log.append('Letra y titulo actualizados para {} cortes ya colocados.'.format(len(retitular)))

        if bloques:
            x0, y0, x1, y1 = usable_rect(target_sheets[0])

            dims_bloques = [dims_bloque(g) for g in bloques]
            asign, n_bins, avisos = empaquetar(dims_bloques, x0, y0, x1, y1)
            for idx in avisos:
                bw, bh = dims_bloques[idx]
                log.append('AVISO: \"{}\" ({:.0f} x {:.0f} mm en papel) es mas grande que el area util de una lamina; ocupa su columna y puede sobrepasar el borde.'.format(
                    elem_name(bloques[idx][0]), bw * 304.8, bh * 304.8))

            # sheets destino vacios (los que ya tienen viewports se omiten)
            usable_sheets = []
            for s in target_sheets:
                if len(list(s.GetAllViewports())) > 0:
                    log.append('AVISO: sheet {} ya tiene vistas colocadas, se omite.'.format(s.SheetNumber))
                else:
                    usable_sheets.append(s)

            def sheet_for_bin(ibin):
                # 02 mete TODAS las vistas en las laminas que existen: si el
                # empaquetado necesita mas bins que laminas disponibles, se reparten
                # en round-robin sobre las mismas laminas (las vistas se montan) -
                # nunca se descarta una vista. El slider regula cuanto se montan.
                if not usable_sheets:
                    return None
                return usable_sheets[ibin % len(usable_sheets)]

            montados = max(0, n_bins - len(usable_sheets)) if usable_sheets else 0

            for idx, grupo in enumerate(bloques):
                ibin, bx, by_top = asign[idx]
                sh = sheet_for_bin(ibin)
                if sh is None:
                    for v in grupo:
                        overflow.append(elem_name(v))
                    continue
                bw, bh = dims_bloques[idx]
                placed += colocar_grupo(grupo, bx, by_top, bw, sh)
    finally:
        TransactionManager.Instance.TransactionTaskDone()

    if overflow:
        log.append('ERROR: no habia ninguna lamina destino disponible; {} vistas quedaron sin colocar.'.format(len(overflow)))
    if montados > 0:
        log.append('AVISO: {} \"paginas\" de mas se montaron sobre las laminas existentes (todas las vistas quedaron colocadas). Baja el slider "Separacion de vistas (%)" para que quepan mas holgadas, o corre 01 con el mismo valor para crear mas laminas.'.format(montados))
    log.insert(0, 'Vistas colocadas: {} de {} (skyline por crop; paginas montadas: {})'.format(placed, total_vistas, montados))
    OUT = log
# ----------------------------------------
log = Watch(py_colocar_viewports_en_grilla)  # graph output
